# Grasshopper definition metro.gh (Grasshopper 1.0.7)
# plug-ins: LunchBox, Urbano

file_path = FilePath("C:\Users\bot\projects\munich_new_metro_pbd\data\munich.csv")
read_file = ReadFile(File=file_path, PerLineParse=True)
read_file_2 = ReadFile(File="C:\Users\bot\projects\munich_new_metro_pbd\data\metro_stations.csv", PerLineParse=True)
read_csv = ReadCSV(CSVString=read_file, Delimiter=";")  # -> Headers, Values
panel = Panel(read_csv.Values)
read_csv_2 = ReadCSV(CSVString=read_file_2, Delimiter=";")  # -> Headers, Values
panel_2 = Panel(read_csv.Headers)
panel_3 = Panel(read_csv_2.Headers)
explode_tree = ExplodeTree(Data=read_csv_2.Values)  # -> Branch0, Branch1, Branch2
explode_tree_2 = ExplodeTree(Data=read_csv.Values)  # -> Branch0, Branch1, Branch2, Branch3, Branch4, Branch5
panel_4 = Panel(explode_tree_2.Branch0)
construct_point = ConstructPoint(XCoordinate=explode_tree.Branch2, YCoordinate=explode_tree.Branch1, ZCoordinate=expr("0", 10))
panel_5 = Panel(explode_tree_2.Branch2)
population = Number(explode_tree_2.Branch5)
panel_6 = Panel(explode_tree_2.Branch1)
bounds = Bounds(Numbers=population)
panel_7 = Panel(population)
project_geographic_point = ProjectGeographicPoint(Point=construct_point, Projection="WSG84 -> UTM", UTMZone="32")  # -> Out, UTMZone
panel_8 = Panel(construct_point)
construct_domain = ConstructDomain(DomainStart=Slider(100, range=1..3000), DomainEnd=Slider(1000, range=1..3000))
parse_polygon = CSharpScript(x=explode_tree_2.Branch2)  # -> out, A; inputs x: String
# ---------- parse_polygon: C# ----------
    var outList = new List<Point3d>();
    var cleanString = x.Substring(10, x.Length - 2 - 10);
    var textCoords = cleanString.Split(',');
    foreach (string textCoord in textCoords){
      var coords = textCoord.Trim().Split(' ');
      //Print(textCoord);
      //Print(coords.Length.ToString());
      //Print("-------");
      outList.Add(new Point3d(double.Parse(coords[0]), double.Parse(coords[1]), 0));
    }
    A = outList;
# ---------- end parse_polygon ----------
panel_9 = Panel(parse_polygon.out)
existing_metro_stations = Point(project_geographic_point.Out)
remap_numbers = RemapNumbers(Value=population, Source=bounds, Target=construct_domain)  # -> Mapped, Clipped
project_geographic_point_2 = ProjectGeographicPoint(Point=parse_polygon.A, Projection="WSG84 -> UTM")  # -> Out, UTMZone
panel_10 = Panel(parse_polygon.A)
unit_z = UnitZ(Factor=remap_numbers.Mapped)
panel_11 = Panel(project_geographic_point_2.Out)
polyline = PolyLine(Vertices=project_geographic_point_2.Out, Closed=True)
boundary_surfaces = BoundarySurfaces(Edges=polyline)  # -> flatten(Surfaces)

# ---- group: Density
area = Area(Geometry=boundary_surfaces)  # -> Area, Centroid
panel_12 = Panel(area.Area)
division = Division(A=population, B=area.Area)

# ----
extrude = Extrude(Base=boundary_surfaces, Direction=unit_z)
point_in_breps = PointInBreps(Brep=extrude, Point=existing_metro_stations, Strict=False)  # -> Inside, Index
panel_13 = Panel(point_in_breps.Index)
panel_14 = Panel(division)
panel_15 = Panel(extrude)
bounds_2 = Bounds(Numbers=division)
panel_16 = Panel(bounds_2)
deconstruct_domain = DeconstructDomain(Domain=bounds_2)  # -> Start, End
gradient = Gradient(
    LowerLimit=deconstruct_domain.Start,
    UpperLimit=deconstruct_domain.End,
    Parameter=division,
    stops=[0: RGB(0, 128, 0), 0.5: RGB(255, 255, 0), 1: RGB(255, 0, 0)])
custom_preview = CustomPreview(Geometry=extrude, Material=gradient)
